# Dynamo custom node CNWithCPython_Child.dyf (Dynamo 3.0.0.0)
# category: Testing
# Child custom node containing a CPython3 Python node.

x = Input(x: var[]..[])
python_script = Python(IN[0]=x)  # CPython3
# ---------- python_script.python (1 lines) ----------
OUT = IN[0] + 10
# ----------------------------------------
OUT = Output(python_script)
