# Dynamo custom node CNWithCPython_Parent.dyf (Dynamo 3.0.0.0)
# category: Testing
# Parent custom node calling the child custom node twice (nested dependency).

x = Input(x: var[]..[])
CNWithCPython_Child = Custom[CNWithCPython_Child](x=x)  # CNWithCPython_Child
CNWithCPython_Child_2 = Custom[CNWithCPython_Child](x=CNWithCPython_Child)
OUT = Output(CNWithCPython_Child_2)
