# Dynamo graph ConvertTabsToSpaces.dyn (Dynamo 3.1.0.3411)

python_script = Python()  # CPython3; unwired: IN[0]; starter script, not edited (OUT = 0)
python_script_2 = Python()  # CPython3; unwired: IN[0]
# ---------- python_script_2.python (14 lines) ----------
# declare x
x = 7
outcome = ""

# random statements
if x == 5:
	outcome = "x is 5"
	if x == 9:
		if x ==10:
			outcome = "impossible"
	else:
		outcome = "x is not 5"
		if x == 1:
			# tab	in	comment
# ----------------------------------------
