# Dynamo graph WithNestedCPythonCustomNodes.dyn (Dynamo 3.0.0.0)
# Opens a parent custom node that depends on a child custom node containing a CPython3 node. The Python migration view extension should auto-upgrade the nested CPython3 node(s) to PythonNet3.

number = DoubleInput(0)
CNWithCPython_Parent = Custom[CNWithCPython_Parent](x=number)  # CNWithCPython_Parent
watch = Watch(CNWithCPython_Parent)
